# Grasshopper definition HelloAntiloop.gh (Grasshopper 0.9.76)
# plug-ins: antiloop

antiloopstart = Antiloop(Number=Slider(8, range=0..10), Bool=Toggle(True))  # -> Number, Loop
antiloopwhile = Antiloop(Number=antiloopstart.Number, Loop=antiloopstart.Loop)
panel = Panel(antiloopstart.Number)
panel_2 = Panel(antiloopwhile)
